# Grasshopper definition testHello.gh (Grasshopper 1.0.7)
# plug-ins: termitesABMStoolkitAlpha

file_path = FilePath("C:\Users\evang\OneDrive\Desktop\190125_DoLAB\")
hello_termites = HelloTermites(NewProjectFilePath=file_path)  # -> NewProjectFilePath, Info, DefaultProjectFilePath
hello_termites_2 = HelloTermites()  # -> NewProjectFilePath, Info, DefaultProjectFilePath
systemsetup = SystemSetup(ProjectFolderFilePath=file_path, NoOfOutputs=Slider(4, range=0..4))  # -> ProjectFolderFilePath, NoOfOutputs, Info
panel = Panel(systemsetup.ProjectFolderFilePath)
panel_2 = Panel(systemsetup.NoOfOutputs)
panel_3 = Panel(systemsetup.Info)
panel_4 = Panel(hello_termites_2.NewProjectFilePath)
panel_5 = Panel(hello_termites.NewProjectFilePath)
panel_6 = Panel(hello_termites.Info)
